# Grasshopper definition tile.gh (Grasshopper 0.9.80)

rectangle = Rectangle(Plane=PlaneXY(0, 0, 0), XSize=Slider(44.25, range=0..100), YSize=Slider(44.25, range=0..100), Radius=0)  # -> Rectangle, Length
polar_array = PolarArray(Geometry=rectangle.Rectangle, Plane=PlaneXY(0, 0, 0), Count=10, Angle=6.283185307)  # -> Geometry, Transform
